# Grasshopper definition algo.gh (Grasshopper 1.0.7)
# plug-ins: MeshEdit Components, LunchBox, Weaverbird, Kangaroo2 Components

path = FilePath("C:\Users\demin\hack\opendata\P18_Hack_Strom.xlsx")
excelread = ExcelReader(ReadExcelData=Toggle(True), WorkbookPath=path, WorksheetName="1")  # -> Exceptions, ExcelData
flip = FlipMatrix(Data=excelread.ExcelData)
item = ListItem(List=flip, Index=0, Wrap=True)  # -> Item, Item1, Item2, Item3, Item4, Item5, Item6, Item7
kill0 = GhPythonScript(x=flatten(item.Item1))  # -> out, a; inputs x: list
# ---------- kill0: Python ----------
__author__ = "demin"
__version__ = "2019.01.22"

import rhinoscriptsyntax as rs

def empty(value):
    try:
        value = float(value)
    except ValueError:
        pass
    return bool(value)
    

a = []
for i, value in enumerate(x):
    if i == 0: continue
    if empty(value): a.append(value)
# ---------- end kill0 ----------
panel = Panel(kill0.a)
unique = GhPythonScript(list1=flatten(kill0.a))  # -> out, a, b; inputs list1: list
# ---------- unique: Python ----------
__author__ = "dmd1"
__version__ = "2019.01.16"

import rhinoscriptsyntax as rs

# Python program to check if two  
# to get unique values from list 
# using traversal  

# function to get unique values 
def unique(list1): 
  
    # intilize a null list 
    unique_list = [] 
      
    # traverse for all elements 
    for x in list1: 
        # check if exists in unique_list or not 
        if x not in unique_list: 
            unique_list.append(x) 
    # print list 
    for x in unique_list: 
        print x, 
      
    return unique_list
  
# driver code 

print("the unique values from 1st list is") 
unique(list1) 

a = unique(list1)

b = [i for i,j in enumerate(a) ]
# ---------- end unique ----------
unique_2 = GhPythonScript(list1=flatten(kill0.a))  # -> out, a, b; inputs list1: list; same code as unique
python = GhPythonScript(x=unique.a, y=flatten(kill0.a))  # -> out, a, b, rooms; inputs x: list, y: list
# ---------- python: Python ----------
__author__ = "dmd1"
__version__ = "2019.01.16"

import rhinoscriptsyntax as rs

a = []
b = []
rooms = []
for i, value_i in enumerate(x):
    count=0
    
    for j, value_j in enumerate(y):
        print value_j
        if value_i == value_j:
            a.append(i)
            b.append(count)
            count+=1
            #print value_i , value_j
    rooms.append(count)
# ---------- end python ----------
lng = ListLength(List=unique_2.a)
pt = ConstructPoint(XCoordinate=0, YCoordinate=0, ZCoordinate=-1)
series = Series(Start=-0.5, Step=expr("x*-1", Slider(0.5, range=0..1)), Count=lng)
xy = XYPlane(Origin=pt)
division = Division(A=python.b, B=Slider(2, range=0..10))
pt_2 = ConstructPoint(XCoordinate=python.a, YCoordinate=0, ZCoordinate=division)
cp = PlaneClosestPoint(Point=pt_2, Plane=xy)  # -> Point, UVPoint, Distance
duppt = RemoveDuplicatePts(Points=cp.Point, Tolerance=0.01)
number_slider = Slider(0.4, range=0..1)
xy_2 = XYPlane(Origin=pt_2)
pdecon = Deconstruct(Point=duppt)  # -> XComponent, YComponent, ZComponent
pt_3 = ConstructPoint(XCoordinate=pdecon.XComponent, YCoordinate=pdecon.YComponent, ZCoordinate=series)
xz = XZPlane(Origin=pt_3)
box = CenterBox(Base=xy_2, X=number_slider, Y=number_slider, Z=Slider(0.1, range=0..1))
pt_4 = Point([<point referenced from the Rhino model> x1879])
pdecon_2 = Deconstruct(Point=pt_4)  # -> XComponent, YComponent, ZComponent
data = Data(pdecon_2.YComponent)
bounds = Bounds(Numbers=data)
deconstruct_domain = DeconstructDomain(Domain=bounds)  # -> Start, End
brep = Brep(box)
pt_5 = Point([<point referenced from the Rhino model> x109])
sph = Sphere(Base=pt_4, Radius=0.0002)
pdecon_3 = Deconstruct(Point=pt_5)  # -> XComponent, YComponent, ZComponent
pt_6 = Point([<point referenced from the Rhino model> x109])
gradient = Gradient(
    LowerLimit=deconstruct_domain.Start,
    UpperLimit=deconstruct_domain.End,
    Parameter=data,
    stops=[0: RGB(234, 38, 0), 0.25: RGB(234, 126, 0), 0.5: RGB(254, 244, 84), 0.75: RGB(173, 203, 249), 1: RGB(75, 107, 169)])
pt_7 = Point([<point referenced from the Rhino model> x33])
pt_8 = ConstructPoint(XCoordinate=pdecon_3.XComponent, YCoordinate=pdecon_3.YComponent, ZCoordinate=0.001)
pdecon_4 = Deconstruct(Point=pt_6)  # -> XComponent, YComponent, ZComponent
pdecon_5 = Deconstruct(Point=pt_7)  # -> XComponent, YComponent, ZComponent
sph_2 = Sphere(Base=pt_8, Radius=0.0003)
pt_9 = ConstructPoint(XCoordinate=pdecon_4.XComponent, YCoordinate=pdecon_4.YComponent, ZCoordinate=0.001)
pt_10 = ConstructPoint(XCoordinate=pdecon_5.XComponent, YCoordinate=pdecon_5.YComponent, ZCoordinate=0.001)
custom_preview = CustomPreview(Geometry=sph_2, Material=ColourSwatch(SwatchColor=RGB(0, 0, 0)))
crv = Curve([<curve referenced from the Rhino model> x3456])
sph_3 = Sphere(Base=pt_9, Radius=0.0003)
sph_4 = Sphere(Base=pt_10, Radius=0.00045)
custom_preview_2 = CustomPreview(Geometry=sph_3, Material=ColourSwatch(SwatchColor=RGB(0, 0, 0)))
custom_preview_3 = CustomPreview(Geometry=sph_4, Material=ColourSwatch(SwatchColor=RGB(255, 0, 0)))
len = Length(Curve=crv)
pt_11 = ConstructPoint(XCoordinate=pdecon_4.XComponent, YCoordinate=pdecon_4.YComponent, ZCoordinate=0)
ma = MassAddition(Input=len)  # -> Result, PartialResults
Z = UnitZ(Factor=1)
ahsl = SplitAHSL(Colour=gradient)  # -> Alpha, Hue, Saturation, Luminance
custom_preview_4 = CustomPreview(Geometry=sph, Material=gradient)
del = DelaunayMesh(Points=pt_5, Plane=PlaneXY(0, 0, 0))
panel_2 = Panel(ma.Result)
move = Move(Geometry=crv, Motion=Z)  # -> Geometry, Transform
hsl = ColourHSL(Alpha=0.6, Hue=ahsl.Hue, Saturation=ahsl.Saturation, Luminance=ahsl.Luminance)
explode = MeshExplode(Mesh=del, Interpolate=False)
area = Area(Geometry=explode)  # -> Area, Centroid
avr = Average(Input=area.Area)
addition = Addition(A=avr, B=avr)
smaller = SmallerThan(FirstNumber=addition, SecondNumber=area.Area)  # -> SmallerThan, OrEqualTo
dispatch = Dispatch(List=explode, DispatchPattern=smaller.SmallerThan)  # -> ListA, ListB
Z_2 = UnitZ(Factor=-1)
move_2 = Move(Geometry=dispatch.ListB, Motion=Z_2)  # -> Geometry, Transform
geo = Geometry(move_2.Geometry)
area_2 = Area(Geometry=geo)  # -> Area, Centroid
data_2 = Data(area_2.Area)
bounds_2 = Bounds(Numbers=data_2)
deconstruct_domain_2 = DeconstructDomain(Domain=bounds_2)  # -> Start, End
gradient_2 = Gradient(
    LowerLimit=deconstruct_domain_2.Start,
    UpperLimit=deconstruct_domain_2.End,
    Parameter=data_2,
    stops=[0: RGB(234, 38, 0), 0.25: RGB(234, 126, 0), 0.5: RGB(254, 244, 84), 0.75: RGB(173, 203, 249), 1: RGB(75, 107, 169)])
ahsl_2 = SplitAHSL(Colour=gradient_2)  # -> Alpha, Hue, Saturation, Luminance
hsl_2 = ColourHSL(Alpha=0.6, Hue=ahsl_2.Hue, Saturation=ahsl_2.Saturation, Luminance=ahsl_2.Luminance)
wbedges = WeaverbirdsMeshEdges(MeshOrPolylines=del)
custom_preview_5 = CustomPreview(Geometry=geo, Material=hsl_2)
