# Grasshopper definition graph_opt.gh (Grasshopper 1.0.7)
# plug-ins: SipderWeb

C = Curve([<curve referenced from the Rhino model> x582])

# ---- group: Creating Graph Edges
genes = GeneList(Decimals=0, Maximum=1, Minimum=0, Value=[0, 1, 0, 0, 1, 1, 1, 1, 1, 1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])
explode = Explode(Curve=C, Recursive=True)  # -> Segments, Vertices
cleansetoflines = CleanSetOfLines(Lines=flatten(explode.Segments))
cull = CullPattern(List=cleansetoflines, CullPattern=genes)
line = Line(cull)
cleansetoflines_2 = CleanSetOfLines(Lines=flatten(line))

# ----
len = Length(Curve=line)
lng = ListLength(List=cleansetoflines)
ma = MassAddition(Input=len)  # -> Result, PartialResults
numberofgenes = Panel(lng)
panel = Panel(ma.Result)
graphfromlines = GraphFromLines(ConnectionLines=cleansetoflines_2)  # -> Graph, GraphDistances, GraphVertex

# ---- group: Starting Points from where the Shortest Path is callculated
lng_2 = ListLength(List=graphfromlines.GraphVertex)
series = Series(Start=0, Step=1, Count=lng_2)

# ----
cir = Circle(Plane=graphfromlines.GraphVertex, Radius=5e-05)

# ---- group: ShortestPath Components
dijk = Dijkstra(Graph=graphfromlines.Graph, GraphDistances=graphfromlines.GraphDistances, StartPoints=series)  # -> Distance, DjikstraGraph
spa = ShortestPathAngular(Graph=graphfromlines.Graph, GraphVertex=graphfromlines.GraphVertex, StartPoints=series)  # -> AngularDistance, ShortestPathGraph; disabled

# ---- group: Fittnessfunktion
# DescriptionFittnes: LongestLine
# Average Distance from all Points to all Points.
# 
# MostTurns
# Average Truns from all Points to all Points.
list = ValueList({"MostTurns": 0, "LongestLine": 1}, selected="LongestLine")
filter = StreamFilter(Gate=list, Stream0=spa.AngularDistance, Stream1=dijk.Distance)
avr = Average(Input=flatten(filter))
fittnessfunktion = Number(avr)

# ----
galapagos = Galapagos(fitness=fittnessfunktion, gene=genes)
panel_2 = Panel(avr)

# ---- group: Analyse / Average Angular Distance from One Cell to All other Cells
num = Number(spa.AngularDistance)  # disabled
srf = Surface(cir)  # disabled
path_mapper = PathMapper(num, source="{A;B}", target="{B}")  # disabled
avr_2 = Average(Input=path_mapper)  # disabled
num_2 = Number(flatten(avr_2))  # disabled
bnd = Bounds(Numbers=num_2)  # disabled
domcomp = DomainComponents(Domain=bnd)  # -> Start, End; disabled
gradient = Gradient(
    LowerLimit=domcomp.Start,
    UpperLimit=domcomp.End,
    Parameter=num_2,
    stops=[0: RGB(0, 0, 255), 0.333: RGB(0, 128, 0), 0.666: RGB(255, 255, 0), 1: RGB(255, 0, 0), 1: RGB(255, 0, 0)])  # disabled
preview = CustomPreview(Geometry=srf, Shader=gradient)  # disabled

# ---- group: Analyse / Average Distance from One Cell to All other Cells
num_3 = Number(dijk.Distance)  # disabled
srf_2 = Surface(cir)  # disabled
path_mapper_2 = PathMapper(num_3, source="{A;B}", target="{B}")  # disabled
avr_3 = Average(Input=path_mapper_2)  # disabled
num_4 = Number(flatten(avr_3))  # disabled
bnd_2 = Bounds(Numbers=num_4)  # disabled
domcomp_2 = DomainComponents(Domain=bnd_2)  # -> Start, End; disabled
gradient_2 = Gradient(
    LowerLimit=domcomp_2.Start,
    UpperLimit=domcomp_2.End,
    Parameter=num_4,
    stops=[0: RGB(0, 0, 255), 0.333: RGB(0, 128, 0), 0.666: RGB(255, 255, 0), 1: RGB(255, 0, 0), 1: RGB(255, 0, 0)])  # disabled
preview_2 = CustomPreview(Geometry=srf_2, Shader=gradient_2)  # disabled

# ---- group: Analyse / ChoiceBetweenPoints with a Maximum Detour
# Restriction: "ChoiceBetweenPoints" does only work reliable with euclidian distances > "ShortestPath"; It will produce no obvious comprehensible results when imput comes from the "ShortestPathAngular" component
max_detour = Slider(1.01, range=1..2)  # disabled
choicebetweenpoints = ChoiceBetweenPoints(
    Graph=graphfromlines.Graph,
    Distance=dijk.Distance,
    GraphVertex=graphfromlines.GraphVertex,
    StartingPoints=series,
    MaximalDetour=max_detour)  # -> ChoiceBetweenPoints, ConnectionLines; disabled
bnd_3 = Bounds(Numbers=choicebetweenpoints.ChoiceBetweenPoints)  # disabled
domcomp_3 = DomainComponents(Domain=bnd_3)  # -> Start, End; disabled
gradient_3 = Gradient(
    LowerLimit=domcomp_3.Start,
    UpperLimit=domcomp_3.End,
    Parameter=choicebetweenpoints.ChoiceBetweenPoints,
    stops=[0: RGB(0, 0, 255), 0.333: RGB(0, 128, 0), 0.666: RGB(255, 255, 0), 1: RGB(255, 0, 0)])  # disabled
preview_3 = CustomPreview(Geometry=choicebetweenpoints.ConnectionLines, Shader=gradient_3)  # disabled

# ---- group: Geometrie
line_2 = Line(graft(line))
end = EndPoints(Curve=line_2)  # -> Start, End
vec2pt = Vector2Pt(PointA=end.Start, PointB=end.End, Unitize=False)  # -> Vector, Length
vcomp = Decompose(Vector=vec2pt.Vector)  # -> XComponent, YComponent, ZComponent
slider = Slider(0.2, range=0..1)
vec = VectorXYZ(XComponent=expr("-x", vcomp.YComponent), YComponent=vcomp.XComponent, ZComponent=0)  # -> Vector, Length
addition = Addition(A=vec.Vector, B=end.Start)
len_2 = Length(Curve=line_2)
lnpt = LinePt(Line=line_2, Point=addition)

# ----
division = Division(A=slider, B=10000)

# ---- group: Geometrie (continued)
width = Number(division)
dom = Domain(DomainStart=expr("-x", width), DomainEnd=width)
addition_2 = Addition(A=len_2, B=width)
subtraction = Subtraction(A=0, B=width)
dom_2 = Domain(DomainStart=addition_2, DomainEnd=subtraction)
rectangle = Rectangle(Plane=lnpt, XSize=dom_2, YSize=dom, Radius=0)  # -> Rectangle, Length
crv = Curve(simplify(flatten(rectangle.Rectangle)))
pcen = PolygonCenter(Polyline=crv)  # -> CenterV, CenterE
sort = SortList(Keys=pcen.CenterV, ValuesA=crv)  # -> Keys, ValuesA
